% Simulink data dictionary buses.sldd
% references wind_bus.sldd

ACT_BUS = Simulink.Bus()
  actualposn_rad: double
  measuredposn_rad: double

AIRFRAME_BUS = Simulink.Bus()
  alpha_rad: double
  wdot: double
  pitchrate_rad_s: double
  pitchrate_rad_s_s: double

CONTROL_BUS = Simulink.Bus()
  actdemand_rad: double

PILOT_BUS = Simulink.Bus()
  StickCommand_rad: double